# Grasshopper definition 01_00_voxelise_planes.gh (Grasshopper 0.9.76)
# Copyright: Co-de-iT

panel = Panel("voxelise geometry ( meshes)")
# Voxelise planes
# 
# generate a 3D voxel planes grid from object
# 
# © a3 2017 _ Creative Commons Attribution-NonCommercial-ShareAlike3.0 UnportedLicense.
geo = Geometry(<mesh referenced from the Rhino model>)
bbox = BoundingBox(Content=geo, Plane=PlaneXY(0, 0, 0))  # -> Box, Box_2
boxprop = BoxProperties(Box=bbox.Box)  # -> Center, Diagonal, Area, Volume, Degeneracy
scale = Scale(Geometry=bbox.Box, Center=boxprop.Center, Factor=Slider(1.5, range=1..3))  # -> Geometry, Transform
box_corners = BoxCorners(Box=scale.Geometry)  # -> CornerA, CornerB, CornerC, CornerD, CornerE, CornerF, CornerG, CornerH
plane_size = Slider(24, range=0..100)
layer_height = Slider(12, range=0..100)
layer_count = Slider(20, range=0..100)
recgrid = Rectangular(
    Plane=box_corners.CornerA,
    SizeX=plane_size,
    SizeY=plane_size,
    ExtentX=Slider(25, range=0..100),
    ExtentY=Slider(24, range=0..100))  # -> Cells, graft(Points)
series = Series(Start=0, Step=layer_height, Count=layer_count)
Z = UnitZ(Factor=series)
move = Move(Geometry=recgrid.Points, Motion=Z)  # -> Geometry, Transform
minc = MeshInclusion(Mesh=geo, Point=move.Geometry, Strict=False)
dispatch = Dispatch(List=move.Geometry, DispatchPattern=minc)  # -> ListA, ListB
pt = Point(dispatch.ListA)
multiplication = Multiplication(A=plane_size, B="0.5")
clean = CleanTree(RemoveNulls=True, RemoveInvalid=True, RemoveEmpty=True, Tree=dispatch.ListA)  # -> flatten(Tree)
neg = Negative(Value=multiplication)
xy = XYPlane(Origin=clean)  # -> simplify(graft(Plane))
dom = ConstructDomain(DomainStart=neg, DomainEnd=multiplication)
rectangle = Rectangle(Plane=xy, XSize=dom, YSize=dom, Radius=0)  # -> Rectangle, Length
# internalise data and copy/paste this in Discretiser_Orientations
# voxel grid-planes
geo_2 = Geometry(rectangle.Rectangle)
