# Grasshopper definition 01_02_discretizer_orientations_multiple components.gh (Grasshopper 0.9.76)
# Copyright: Co-de-iT
# plug-ins: Human

# ---- group: case 01
panel = Panel("module geometry")
panel_2 = Panel("geometry center point")
geo = Geometry(<mesh referenced from the Rhino model>)
pt = Point(<point referenced from the Rhino model>)

# ----
panel_3 = Panel("field curves")
# planes can be filtered here according to custom-based criteria (ex. boundaries or conditions such as being too close/too far from something)
panel_4 = Panel("""voxel planes
from 01_00 file""")

# ---- group: case 00
# discretiser/orientations - multiple components
# 
# orient object to planes by field
# 
# © a3 2017 _ Creative Commons Attribution-NonCommercial-ShareAlike3.0 UnportedLicense.
geo_2 = Geometry(<mesh referenced from the Rhino model>)
pt_2 = Point(<point referenced from the Rhino model>)

# ----
crv = Curve([<curve referenced from the Rhino model> x3])
crv_2 = Curve([<curve referenced from the Rhino model> x234])
sampling_distance = Slider(29, range=0..100)
group = Group(Objects=geo_2)
pt_3 = Point(pt_2)
group_2 = Group(Objects=geo)
pt_4 = Point(pt)
area = Area(Geometry=crv_2)  # -> Area, Centroid
field_threshold = Slider(480, range=0..1000)

# ---- group: filter planes and find field tangent vectors
divdist = DivideDistance(Curve=crv, Distance=sampling_distance)  # -> flatten(Points), flatten(Tangents), Parameters
cp = ClosestPoint(Point=area.Centroid, Cloud=divdist.Points)  # -> ClosestPoint, CPIndex, Distance
# planes can also be filtered here according to custom-based criteria
smaller = SmallerThan(FirstNumber=cp.Distance, SecondNumber=field_threshold)  # -> SmallerThan, OrEqualTo
item = ListItem(List=divdist.Tangents, Index=cp.CPIndex, Wrap=True)
dispatch = Dispatch(List=area.Centroid, DispatchPattern=smaller.SmallerThan)  # -> ListA, ListB
dispatch_2 = Dispatch(List=item, DispatchPattern=smaller.SmallerThan)  # -> ListA, ListB

# ----
pt_5 = Point(dispatch.ListB)

# ----
# discretize directions
n_directions = Panel("4")
discretize_vectors = DiscretizeVectors(vectors=dispatch_2.ListA, n_of_directions=n_directions)  # -> discretized_vectors, discretized_vector_grouped_by_direction, discrete_directions

# ----
# display discrete directions
# on origin (0,0,0)
pt_6 = Point(Point(0, 0, 0))
vdisex = VectorDisplayEx(Point=pt_6, Vector=discretize_vectors.discrete_directions, Colour=discretize_vectors.discrete_directions, Width=2)
Z = UnitZ(Factor=1)
vrot = Rotate(Vector=discretize_vectors.discretized_vectors, Axis=Z, Angle="Pi*0.5")
pl = ConstructPlane(Origin=dispatch.ListA, XAxis=discretize_vectors.discretized_vectors, YAxis=vrot)
# "continuous" directions
line = LineSDL(Start=dispatch.ListA, Direction=dispatch_2.ListA, Length=Slider(10, range=0..100))
# discrete directions
line_2 = LineSDL(Start=dispatch.ListA, Direction=discretize_vectors.discretized_vectors, Length=Slider(24, range=0..100))
Y = UnitY(Factor=Slider(500, range=0..1000))

# ----
# select elements by orientation
mindex = MemberIndex(Set=discretize_vectors.discretized_vectors, Member=discretize_vectors.discrete_directions)  # -> Index, Count

# ----
# converte un range di valori in un numero discreto di interi (utile per assegnare componenti)
n_of_components = Slider(2, range=1..6)
# scalar field to discrete values
# (component type selection)
# i componenti sono assegnati a seconda della distanza dalla curva più vicina. Il pattern di distribuzione può anche essere alterato con un graph mapper.
# insert values to discretize here
num = Number(cp.Distance)
bnd = Bounds(Numbers=num)
remap = RemapNumbers(Value=num, Source=bnd, Target=Domain(0, 1))  # -> Mapped, Clipped
subtraction = Subtraction(A=n_of_components, B="1")

graph = GraphMapper(
    remap.Mapped,
    x0=0,
    x1=1,
    y0=0,
    y1=1,
    container_name="Bezier",
    cpx=[0, 0.5520546436, 0.3164388537, 1],
    cpy=[0, 0.1536232829, 0.9652172327, 1])

multiplication = Multiplication(A=graph, B=subtraction)

# ----
# selection pattern
int = Integer(multiplication)

# ---- group: geometries
# select components
weave = Weave(Pattern=graft(int), Stream0=group, Stream1=group_2, NullGaps=False)  # -> flatten(Weave)

# ---- group: base points
weave_2 = Weave(Pattern=graft(int), Stream0=pt_3, Stream1=pt_4, NullGaps=False)  # -> flatten(Weave)

# ----
# selection pattern
# select elements by type
series = Series(Start=0, Step=1, Count=n_of_components)
int_2 = Integer(series)
int_3 = Integer(int)
mindex_2 = MemberIndex(Set=int_3, Member=int_2)  # -> Index, Count

xy = XYPlane(Origin=weave_2)
orient = Orient(Geometry=weave, Source=xy, Target=pl)  # -> Geometry, Transform
move = Move(Geometry=orient.Geometry, Motion=Y)  # -> Geometry, Transform
item_2 = ListItem(List=orient.Geometry, Index=mindex_2.Index, Wrap=True)
item_3 = ListItem(List=orient.Geometry, Index=mindex.Index, Wrap=True)
bang = ExplodeTree(Data=item_2)  # -> Branch0, Branch1
bang_2 = ExplodeTree(Data=item_3)  # -> _0000, _0001, _0002, _0003
ungroup = Ungroup(Group=bang.Branch0)
ungroup_2 = Ungroup(Group=bang.Branch1)
ungroup_3 = Ungroup(Group=bang_2._0000)
ungroup_4 = Ungroup(Group=bang_2._0001)
ungroup_5 = Ungroup(Group=bang_2._0002)
ungroup_6 = Ungroup(Group=bang_2._0003)
ungroup_7 = Ungroup(Group=orient.Geometry)
# oriented geometry by type
previewmat = CustomPreviewMaterials(Geometry=ungroup_2, DiffuseColor=ColourSwatch(SwatchColor=RGB(255, 0, 0)))
previewmat_2 = CustomPreviewMaterials(Geometry=ungroup, DiffuseColor=ColourSwatch(SwatchColor=RGB(255, 255, 255)))
previewmat_3 = CustomPreviewMaterials(Geometry=ungroup_4, DiffuseColor=ColourSwatch(SwatchColor=RGB(255, 0, 0)))
# oriented geometry by orientation
previewmat_4 = CustomPreviewMaterials(Geometry=ungroup_5, DiffuseColor=ColourSwatch(SwatchColor=RGB(98, 255, 0)))
previewmat_5 = CustomPreviewMaterials(Geometry=ungroup_6, DiffuseColor=ColourSwatch(SwatchColor=RGB(0, 200, 255)))
# oriented geometry
previewmat_6 = CustomPreviewMaterials(Geometry=ungroup_7, DiffuseColor=RGB(255, 255, 255))
previewmat_7 = CustomPreviewMaterials(Geometry=ungroup_3, DiffuseColor=ColourSwatch(SwatchColor=RGB(255, 255, 255)))

# ==== cluster DiscretizeVectors
vectors = ClusterInput()
n_of_directions = ClusterInput()
one_over_x = OneOverX(Value=n_of_directions)
neg = Negative(Value=one_over_x)
pi = Pi(Factor=neg)
X = UnitX(Factor=1)
Z = UnitZ(Factor=1)
vrot = Rotate(Vector=X, Axis=Z, Angle=pi)
xy = XYPlane(Origin=Point(0, 0, 0))
pi_2 = Pi(Factor="2")
angle = Angle(VectorA=vectors, VectorB=vrot, Plane=xy)  # -> Angle, Reflex
range = Range(Domain=pi_2, Steps=n_of_directions)
cull_i = CullIndex(List=range, Indices="-1", Wrap=True)
remap = RemapNumbers(Value=angle.Reflex, Source="0 to 2*Pi", Target=Domain(0, 1))  # -> Mapped, Clipped
multiplication = Multiplication(A=remap.Clipped, B=n_of_directions)
X_2 = UnitX(Factor=1)
Z_2 = UnitZ(Factor=1)
expression = Expression(x=multiplication, Expression="floor(x)")
vrot_2 = Rotate(Vector=X_2, Axis=Z_2, Angle=cull_i)
item = ListItem(List=vrot_2, Index=graft(expression), Wrap=True)  # -> flatten(Item)

# ----
# group by direction
series = Series(Start=0, Step=1, Count=n_of_directions)
int = Integer(series)
mindex = MemberIndex(Set=expression, Member=int)  # -> Index, Count

discretized_vectors = ClusterOutput(item)
discrete_directions = ClusterOutput(vrot_2)
discretized_vector_grouped_by_direction = ClusterOutput(mindex.Index)
