# Grasshopper definition ds_sub_00_mesh box orient.gh (Grasshopper 0.9.76)
# Copyright: Co-de-iT
# plug-ins: Weaverbird

# File template
# 
# © a3 2017 _ Creative Commons Attribution-NonCommercial-ShareAlike3.0 UnportedLicense.
mesh = Mesh(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)
wbcatmullclark = WeaverbirdsCatmullClarkSubdivision(MeshCurves=mesh, Level=Slider(2, range=1..3), SmoothNakedEdges=1)
mesh_2 = Mesh(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)
demesh = DeconstructMesh(Mesh=wbcatmullclark)  # -> Vertices, Faces, Colours, Normals
deface = DeconstructFace(Face=graft(demesh.Faces))  # -> CornerA, CornerB, CornerC, CornerD
merge = Merge(Data1=deface.CornerA, Data2=deface.CornerB, Data3=deface.CornerC, Data4=deface.CornerD)
item = ListItem(List=demesh.Vertices, Index=merge, Wrap=True)  # -> simplify(Item)
item_2 = ListItem(List=demesh.Normals, Index=merge, Wrap=True)  # -> simplify(Item)
amp = Amplitude(Vector=item_2, Amplitude=Slider(1.73, range=0..5))
move = Move(Geometry=item, Motion=amp)  # -> Geometry, Transform
item_3 = ListItem(List=item, Index=0, Wrap=True)  # -> Item, Item1, Item2, Item3
item_4 = ListItem(List=move.Geometry, Index=0, Wrap=True)  # -> Item, Item1, Item2, Item3
tbox = TwistedBox(
    CornerA=item_3.Item,
    CornerB=item_3.Item1,
    CornerC=item_3.Item2,
    CornerD=item_3.Item3,
    CornerE=item_4.Item,
    CornerF=item_4.Item1,
    CornerG=item_4.Item2,
    CornerH=item_4.Item3)
