# Grasshopper definition XX_00_topologizer.gh (Grasshopper 1.0.7)
# Copyright: Co-de-iT

# network of unique lines, all meeting only at end points
crv = Curve([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])
preview = CustomPreview(
    Geometry=crv,
    Shader={diffuse=RGB(255, 105, 180), emission=RGB(76, 32, 54), shine=0.5, specular=RGB(255, 255, 255), transparency=0})

end = EndPoints(Curve=crv)  # -> Start, End
merge = Merge(Data1=end.Start, Data2=end.End)  # -> flatten(Result)
cset = CreateSet(List=merge)  # -> Set, Map
mindex = MemberIndex(Set=cset.Set, Member=end.Start)  # -> Index, Count
# find topological connections
# (GH method by Alessio Erioli)
mindex_2 = MemberIndex(Set=cset.Set, Member=end.End)  # -> Index, Count

# ----
# Topologizer
# 
# Find unique points and connections for a line network
# 
# © a3 2017 _ Creative Commons Attribution-NonCommercial-ShareAlike3.0 UnportedLicense.
lng = ListLength(List=crv)
series = Series(Start=0, Step=1, Count=lng)
int = Integer(series)
vec = Vector(crv)
mindex_3 = MemberIndex(Set=end.Start, Member=cset.Set)  # -> simplify(Index), Count
mindex_4 = MemberIndex(Set=end.End, Member=cset.Set)  # -> simplify(Index), Count
item = ListItem(List=cset.Set, Index=mindex.Index, Wrap=True)
item_2 = ListItem(List=cset.Set, Index=mindex_2.Index, Wrap=True)
item_3 = ListItem(List=vec, Index=mindex_3.Index, Wrap=True)
item_4 = ListItem(List=vec, Index=mindex_4.Index, Wrap=True)
rev = Reverse(Vector=item_4)
expression = Expression(x=mindex.Index, y=mindex_2.Index, Expression="Format(\"{0}-{1}\",int(x), int(y))")  # -> flatten(R)
merge_2 = Merge(Data1=mindex_3.Index, Data2=mindex_4.Index)
merge_3 = Merge(Data1=item_3, Data2=rev)
amp = Amplitude(Vector=merge_3, Amplitude=Slider(3.515, range=0..10))
lng_2 = ListLength(List=cset.Set)
avr = Average(Input=[item, item_2])  # -> flatten(ArithmeticMean)
move = Move(Geometry=graft(cset.Set), Motion=amp)  # -> Geometry, Transform
lng_3 = ListLength(List=merge_2)  # -> flatten(Length)
series_2 = Series(Start=0, Step=1, Count=lng_2)
unit = UnitVector(Vector=amp)
int_2 = Integer(series_2)
# connected lines vectors
vdisex = VectorDisplayEx(Point=graft(cset.Set), Vector=unit, Colour=ColourSwatch(SwatchColor=RGB(255, 191, 0)), Width=2)
# connected lines tags
tag = TextTag3D(Location=move.Geometry, Text=merge_2, Size=1, Colour=ColourSwatch(SwatchColor=RGB(255, 191, 0)), Justification=7)
# point valence
tag_2 = TextTag3D(
    Location=cset.Set,
    Text=lng_3,
    Size=Slider(2, range=0..5),
    Colour=ColourSwatch(SwatchColor=RGB(135, 135, 135)),
    Justification=3)
# point tags
tag_3 = TextTag3D(
    Location=cset.Set,
    Text=int_2,
    Size=Slider(3, range=0..5),
    Colour=ColourSwatch(SwatchColor=RGB(255, 255, 255)),
    Justification=7)
# connection tags
tag_4 = TextTag3D(
    Location=avr,
    Text=expression,
    Size=Slider(2, range=0..5),
    Colour=ColourSwatch(SwatchColor=RGB(8, 8, 8)),
    Justification=8)
# lines tags
tag_5 = TextTag3D(Location=avr, Text=int, Size=Slider(2, range=0..5), Colour=ColourSwatch(SwatchColor=RGB(148, 117, 55)), Justification=2)
