# Grasshopper definition XX_01_discrete vectors.gh (Grasshopper 0.9.76)
# Copyright: Co-de-iT

Z = UnitZ(Factor=1)
X = UnitX(Factor=1)
range = Range(Domain="0 to 360", Steps=Slider(10, range=1..100))
Z_2 = UnitZ(Factor=1)
X_2 = UnitX(Factor=1)
# discrete vectors component
# 
# © a3 2017 _ Creative Commons Attribution-NonCommercial-ShareAlike3.0 UnportedLicense.
vrot = Rotate(Vector=X, Axis=Z, Angle=degrees(Slider(72.25, range=0..360)))
pt = Point(Point(0, 0, 0))
vrot_2 = Rotate(Vector=X_2, Axis=Z_2, Angle=degrees(range))
vdisex = VectorDisplayEx(Point=pt, Vector=vrot, Colour=ColourSwatch(SwatchColor=RGB(135, 135, 135)), Width=2)
pt_2 = Point(Point(0, 0, 0))

n_directions = Panel("4")
discretize_vectors = DiscretizeVectors(vectors=vrot_2, n_of_directions=n_directions)  # -> discretized_vectors, discretized_vector_grouped_by_direction, discrete_directions

# ----
# discretize directions
n_directions_2 = Panel("4")
discretize_vectors_2 = DiscretizeVectors(vectors=vrot, n_of_directions=n_directions_2)  # -> discretized_vectors, discretized_vector_grouped_by_direction, discrete_directions

# ----
# discretize directions
vdisex_2 = VectorDisplayEx(Point=pt_2, Vector=vrot_2, Colour=ColourSwatch(SwatchColor=RGB(135, 135, 135)), Width=2)
pt_3 = Point(Point(0, 0, 0))
pt_4 = Point(Point(0, 0, 0))
panel = Panel(discretize_vectors.discretized_vector_grouped_by_direction)
vdisex_3 = VectorDisplayEx(Point=pt_3, Vector=discretize_vectors.discretized_vectors, Colour=RGB(0, 0, 0), Width=2)
vdisex_4 = VectorDisplayEx(Point=pt_4, Vector=discretize_vectors_2.discretized_vectors, Colour=RGB(0, 0, 0), Width=2)

# ==== cluster DiscretizeVectors
vectors = ClusterInput()
n_of_directions = ClusterInput()
one_over_x = OneOverX(Value=n_of_directions)
neg = Negative(Value=one_over_x)
pi = Pi(Factor=neg)
X = UnitX(Factor=1)
Z = UnitZ(Factor=1)
vrot = Rotate(Vector=X, Axis=Z, Angle=pi)
xy = XYPlane(Origin=Point(0, 0, 0))
pi_2 = Pi(Factor="2")
angle = Angle(VectorA=vectors, VectorB=vrot, Plane=xy)  # -> Angle, Reflex
range = Range(Domain=pi_2, Steps=n_of_directions)
cull_i = CullIndex(List=range, Indices="-1", Wrap=True)
remap = RemapNumbers(Value=angle.Reflex, Source="0 to 2*Pi", Target=Domain(0, 1))  # -> Mapped, Clipped
multiplication = Multiplication(A=remap.Clipped, B=n_of_directions)
X_2 = UnitX(Factor=1)
Z_2 = UnitZ(Factor=1)
expression = Expression(x=multiplication, Expression="floor(x)")
vrot_2 = Rotate(Vector=X_2, Axis=Z_2, Angle=cull_i)
item = ListItem(List=vrot_2, Index=graft(expression), Wrap=True)  # -> flatten(Item)

# ----
# group by direction
series = Series(Start=0, Step=1, Count=n_of_directions)
int = Integer(series)
mindex = MemberIndex(Set=expression, Member=int)  # -> Index, Count

discretized_vectors = ClusterOutput(item)
discrete_directions = ClusterOutput(vrot_2)
discretized_vector_grouped_by_direction = ClusterOutput(mindex.Index)
